# Grasshopper definition Example_NewOldSender.gh (Grasshopper 1.0.7)
# Copyright: Arup
# plug-ins: Speckle (CX)

# ----
# Old Way
# New Way!
# Provide the Account
txt = Text("https://uk.speckle.arup.com/api")
arup_uk_sp_stamatios = Accounts(email="stamatios.psarras@arup.com", restapi="https://uk.speckle.arup.com/api")
panel = Panel(txt)
ca = CreateAccount(RestApi=panel, Token="Secret Token!")

streamid = Text("gpCtDnKIZv")

# ---- group: This needs to Exist
panel_2 = Panel(streamid)

# ---- group: Optionally Select the Project
projects = Projects(Account=arup_uk_sp_stamatios)  # -> Projects, SelectedProject
item = ListItem(List=projects.Projects, Index=0, Wrap=True)

# ---- group: Your Data!
conmesh = ConstructMesh(Vertices=[Point(0, 0, 0), Point(10, 0, 0), Point(10, 10, 0), Point(0, 10, 0)], Faces={A=0, B=1, C=2, D=3})
series = Series(Start=0, Step=1, Count=10)
pt = ConstructPoint(XCoordinate=0, YCoordinate=0, ZCoordinate=0)

# Or
pt_2 = ConstructPoint(XCoordinate=0, YCoordinate=0, ZCoordinate=0)
series_2 = Series(Start=0, Step=1, Count=10)
conmesh_2 = ConstructMesh(Vertices=[Point(0, 0, 0), Point(10, 0, 0), Point(10, 10, 0), Point(0, 10, 0)], Faces={A=0, B=1, C=2, D=3})

# ----
# This will take care your Account from
# the Speckle Account Manager
anonymous_stream = DataSender(A=pt, B=series, C=conmesh, AccountRequired=False, DebouncingDisabled=False, manualmode=False, remotecontroller=False)  # -> Log, StreamId

dss = DataSenderSync(Account=arup_uk_sp_stamatios, StreamId=panel_2, Project=item, A=pt_2, B=series_2, C=conmesh_2)
