# Grasshopper definition SencReceiver_GetOutdatedFlag.gh (Grasshopper 1.0.7)
# Copyright: Arup
# plug-ins: Speckle (CX)

arup_uk_sp_stamatios = Accounts(email="stamatios.psarras@arup.com", restapi="https://uk.speckle.arup.com/api")
# Test: Once opened you are expected to see "Outdated" on the Receiver, reason being the Sender would have just fired on the same frame.
# 
# Changing  values on Sender should flag Outdated on Receiver
# 
# "Force update" from receiver context menu would clear the flags and provide you with fresh data.
number_slider = Slider(350, range=0..1000)
streams = Streams(Account=arup_uk_sp_stamatios, History=False)
item = ListItem(List=streams, Index=0, Wrap=True)  # -> Item1, Item
eo = ExpandObject(Object=item.Item1)  # -> StreamId, Name, Description, Tags, Objects, Layers, BaseProperties, GlobalMeasures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
txt = Text("_rUb8piHe")
panel = Panel(txt)
dss = DataSenderSync(Account=arup_uk_sp_stamatios, StreamId=panel, A=number_slider, B=number_slider)
drs = DataReceiverSync(Account=arup_uk_sp_stamatios, Stream=panel)
dsr = Deserialiser(Object=drs)
panel_2 = Panel(dsr)
