# Grasshopper definition SenderProjectID_CoveringDifferentInputsOnProjectID_ThrowsAppropriateMessages.gh (Grasshopper 1.0.7)
# Copyright: Arup
# plug-ins: Speckle (CX)

speckle_he_psarras_st = Accounts(email="psarras.st@gmail.com", restapi="https://hestia.speckle.works/api")
projects = Projects(Account=speckle_he_psarras_st)  # -> Projects, SelectedProject
pt = Point(Point(-6.851655366, -29.31071468, 0))
eo = ExpandObject(Object=projects.Projects)  # -> _id, Name, Number, Users, Streams, SubProjects, Owner, Private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
panel = Panel(eo._id)
filter = StreamFilter(Gate=Slider(2, range=0..3), Stream0="asd", Stream1=pt, Stream2=projects.Projects, Stream3=panel)
number_slider = Slider(0.617, range=0..1)
panel_2 = Panel(filter)
conmesh = ConstructMesh(Vertices=[Point(0, 0, 0), Point(10, 0, 0), Point(10, 10, 0), Point(0, 10, 0)], Faces={A=0, B=1, C=2, D=3})
swatch = ColourSwatch(SwatchColor=RGB(255, 255, 255))
anonymous_stream = DataSender(
    Project=filter,
    A=number_slider,
    B=number_slider,
    C=conmesh,
    DebouncingDisabled=False,
    manualmode=False,
    remotecontroller=False)  # -> Log, StreamId
anonymous_stream_2 = DataReceiver(ID=anonymous_stream.StreamId, deserialize=True)  # -> _5803b857Df7b4bf28a9dE9ba61bb8cf4, _57351f10B29d402681f30e39891f50ed, _63938cadD0a34d38B479E04f55674b53
