# Grasshopper definition SyncReceiverWithQuery_WithOrWithoutQuery_ReceivesOnlyQueriedDataSynchronously.gh (Grasshopper 1.0.7)
# Copyright: Arup
# plug-ins: Speckle (CX)

# ---- group: Data Gen
msphere = MeshSphere(Base=PlaneXY(0, 0, 0), Radius=10, UCount=10, VCount=20)
mplane = MeshPlane(Boundary={Plane=PlaneXY(0, 0, 0), Size=Domain2(u=-10..10, v=-10..10)}, WidthCount=10, HeightCount=10)  # -> Mesh, Area
anonymous_stream = DataSender(
    A=[msphere, mplane.Mesh],
    B=[msphere, Slider(20, range=0..100)],
    C=[mplane.Mesh, Slider(0, range=0..10)],
    AccountRequired=False,
    DebouncingDisabled=False,
    manualmode=False,
    remotecontroller=False)  # -> Log, StreamId

# ---- group: Multiple Streams Query
arup_irela_stamatios = Accounts(email="stamatios.psarras@arup.com", restapi="https://ireland.speckle.arup.com/api")
streams = Streams(Account=arup_irela_stamatios, History=False)
eud = ExpandDictionaryOrSpeckleObjectProperties(Dictionaries=streams)  # -> StreamId, Name, Description, Layers, Tags, Parent, Children, Ancestors
qb = QueryBuilder(Types="Number", Conditions="value<6")
drs = DataReceiverSync(Account=arup_irela_stamatios, Stream=eud.StreamId, Query=qb)
dsr = Deserialiser(Object=drs)
panel = Panel(dsr)

# ---- group: Without Query
arup_uk_sp_stamatios = Accounts(email="stamatios.psarras@arup.com", restapi="https://uk.speckle.arup.com/api")
panel_2 = Panel(anonymous_stream.StreamId)
eo = ExpandObject(Object=arup_uk_sp_stamatios)  # -> AccountId, ServerName, RestApi, Email, Token, IsDefault
ca = CreateAccount(RestApi=eo.RestApi, Token=eo.Token)
drs_2 = DataReceiverSync(Account=ca, Stream=panel_2)

# ---- group: With Queries / Meshes
panel_3 = Panel("""type
vertices
faces
_id""")
qb_2 = QueryBuilder(Types="Mesh", Layers="A", Fields=panel_3, Sort="_id")
panel_4 = Panel(qb_2)

# ---- group: With Queries / Numbers
panel_6 = Panel("""B
A
C""")
panel_7 = Panel("""type
value
_id
canRead
canWrite""")
qb_3 = QueryBuilder(Types="Number", Layers=panel_6, Fields=panel_7, Conditions="value>=3")

# ---- group: With Queries / Custom Query
panel_8 = Panel("value<3")

# ---- group: With Queries
filter = StreamFilter(Gate=Slider(0, range=0..2), Stream0=qb_2, Stream1=qb_3, Stream2=panel_8)
drs_3 = DataReceiverSync(Account=arup_uk_sp_stamatios, Stream=panel_2, Query=filter)

# ----
dsr_2 = Deserialiser(Object=drs_2)
panel_9 = Panel(drs_2)
dsr_3 = Deserialiser(Object=drs_3)
panel_10 = Panel(dsr_3)
