# Grasshopper definition SyncSender_TaskCapable.gh (Grasshopper 1.0.7)
# Copyright: Arup
# plug-ins: Speckle (CX)

arup_uk_sp_stamatios = Accounts(email="stamatios.psarras@arup.com", restapi="https://uk.speckle.arup.com/api")
number_slider = Slider(100, range=0..100)
projects = Projects(Account=arup_uk_sp_stamatios)  # -> Projects, SelectedProject
cone = Cone(Base=PlaneXY(0, 0, 0), Radius=0.5, Length=1)  # -> Cone, Tip
random = Random(Range=Slider(500, range=0..1000), Number=1, Seed=Slider(5, range=0..10))
smooth = SettingsQuality()
rectangle = Rectangle(Plane=PlaneXY(0, 0, 0), XSize=Domain(-1, 1), YSize=Domain(-2, 2), Radius=0)  # -> Rectangle, Length
series = Series(Start=0, Step=1, Count=10)
sph = Sphere(Base=PlaneXY(0, 0, 0), Radius=1)
item = ListItem(List=projects.Projects, Index=0, Wrap=True)
mesh = MeshBrep(Brep=cone.Cone, Settings=smooth)
mcol = MeshColours(
    Mesh=mesh,
    Colours=[RGB(127, 255, 0), RGB(0, 100, 0), RGB(34, 139, 34), RGB(124, 252, 0), RGB(154, 205, 50), RGB(173, 255, 47), RGB(50, 205, 50), RGB(152, 251, 152)])
dup = DuplicateData(Data=mcol, Number=random, Order=True)
dss = DataSenderSync(Account=arup_uk_sp_stamatios, StreamId="8vLlZfYG9", Project=item, A=Slider(10, range=0..10))
python = GhPythonScript(x="8vLlZfYG9", y=dss)  # -> out, a
# ---------- python: Python ----------
__author__ = "Stamatios.Psarras"
__version__ = "2021.02.23"

import rhinoscriptsyntax as rs

a = x
# ---------- end python ----------
drs = DataReceiverSync(Account=arup_uk_sp_stamatios, Stream=python.a)
dsr = Deserialiser(Object=drs)
panel = Panel(dsr)
