# Grasshopper definition SyncSender_WithinOneFrame_SendsDataOnline.gh (Grasshopper 1.0.7)
# Copyright: Arup
# plug-ins: Speckle (CX)

rhino_compute_mode_true = RhinoComputeMode(RhinoComputeMode=True)
# Find you Account Token from the online portal and input it here.
# 
# To show the behaviour. - save your token
# - then close this file
# - Disable solver
# - Open this file
# - Change the slider (A) value to something else.
# - Recompute once (while disabled)
# - Go online and check the data were send.
txt = Text("https://hestia.speckle.works/api")
txt_2 = Text()
ca = CreateAccount(RestApi=txt, Token=txt_2)
anonymous_stream = DataSender(
    Account=ca,
    StreamId="8rQpMf5Hd",
    A=Slider(0, range=0..10),
    AccountRequired=True,
    DebouncingDisabled=True,
    manualmode=False,
    remotecontroller=False)  # -> Log, StreamId
panel = Panel(anonymous_stream.Log)
